# Dynamo graph Random Single Story Building.dyn (Dynamo 1.3.3.4111)

number_slider = DoubleSlider(10.2, range=0..100 step 0.1)
number_slider_2 = DoubleSlider(37.8, range=0..500 step 0.1)
byCoordinates = Point.ByCoordinates(x=number_slider, y=number_slider_2)
number_slider_3 = DoubleSlider(20, range=0..3000 step 0.1)
number_slider_4 = DoubleSlider(0, range=0..1000 step 0.1)
byCoordinates_2 = Point.ByCoordinates(x=number_slider_3, y=number_slider_4)
number_slider_5 = DoubleSlider(0, range=0..100 step 0.1)
number_slider_6 = DoubleSlider(0, range=0..500 step 0.1)
byCoordinates_3 = Point.ByCoordinates(x=number_slider_5, y=number_slider_6)
number_slider_7 = DoubleSlider(0, range=0..100 step 0.1)
number_slider_8 = DoubleSlider(25, range=0..500 step 0.1)
byCoordinates_4 = Point.ByCoordinates(x=number_slider_7, y=number_slider_8)
create = List.Create(byCoordinates, byCoordinates_2, byCoordinates_3, byCoordinates_4)
boolean = BoolSelector(true)
byPoints = PolyCurve.ByPoints(points=create, connectLastToFirst=boolean)
curves = PolyCurve.Curves(byPoints)
levels = Levels("Level 1")
levels_2 = Levels("Level 2")
wall_types = WallTypes("Interior - 126mm Partition (2-hr)")
byCurveAndLevels = Wall.ByCurveAndLevels(curves, levels, levels_2, wall_types)
flatten = Flatten(curves)
code_block = CodeBlock { "Generic Roof - 300mm"; }
byName = RoofType.ByName(code_block)
levels_3 = Levels("Level 2")
byOutlineTypeAndLevel = Roof.ByOutlineTypeAndLevel(outline=flatten, roofType=byName, level=levels_3)
floor_types = FloorTypes("150mm Foundation Slab")
byOutlineTypeAndLevel_2 = Floor.ByOutlineTypeAndLevel(outline=flatten, floorType=floor_types, level=levels)
